# Grasshopper definition depthscanner_ghpython.gh (Grasshopper 1.0.7)

# ---- group: pcScan
scan = GhPythonScript(start=Toggle(False))  # -> out, points; inputs start: Boolean
# ---------- scan: Python ----------
import compas
import compas_rhino
import rhinoscriptsyntax as rs

from compas.rpc import Proxy

from compas_ghpython import unload_modules
unload_modules('depthscanner')

if start:

    depthscanner = Proxy('depthscanner')
    pts = depthscanner.pcScan()
    Proxy.stop_server(depthscanner)

    ## convert the list to points and add to pointcloud
    points = []
    for i in pts:
        pnt = rs.CreatePoint(i[0],i[1],i[2])
        points.append(pnt)
        
    print('Successfully captured ' + str(len(points)) + ' points.')
# ---------- end scan ----------

# ---- group: dfScan
scan_2 = GhPythonScript(server=Toggle(True), scan=Toggle(True))  # -> out, df; inputs scan: Boolean
# ---------- scan_2: Python ----------
"""Scans the sandbox using the Docofossor format using the Intel Realsense D415
    Inputs:
        start: Start the scan
    Output:
        df: The Docofossor list"""

__author__     = ['Ilmar Hurkxkens']
__license__    = 'MIT License'
__email__      = ['hurkxkens@arch.ethz.ch']

# install the depthscanner package to use this script: 
# https://github.com/ilmihur/depthscanner.git

from compas.rpc import Proxy

if server:
    depthscanner = Proxy('depthscanner')
else:
    Proxy.stop_server(depthscanner)
if scan:
    df = depthscanner.testfunc()
# ---------- end scan_2 ----------

# ----
panel = Panel(scan.out)
python = GhPythonScript(x=scan_2.df)  # -> out, a; inputs x: list
# ---------- python: Python ----------
import Rhino.Geometry as rg

pts = []

for pt in x:
    pts.append(rg.Point3d(pt[0], pt[1], pt[2]))

a = pts
# ---------- end python ----------
panel_2 = Panel(scan_2.out)
partition = PartitionList(List=python.a, Size=Slider(30, range=0..100))
srfgrid = SurfaceFromPoints(Points=python.a, UCount="30", Interpolate=False)
bang = ExplodeTree(Data=partition)
